# Dynamo graph workshop_3-exercicio_com_python_xlsx.dyn (Dynamo 2.18.1.5096)

file_path = Filename("C:\Users\Hadassa Medeiros\Documents\Curso Analise e autom dados construcao Python e Power BI\webscraping_inmuebles_curso_powerBI\Nuevo Hoja de cálculo XLSX.xlsx")
family_types = FamilyTypes("Porta_vidro_sem_moldura:PV01")
all_elements_of_family_type = ElementsOfFamilyType(Family_Type=family_types)
list_create = List.Create(item0=all_elements_of_family_type)
python_script = Python(IN[0]=list_create)  # CPython3; unwired: IN[1]
# ---------- python_script.python (15 lines) ----------
# Load the Python Standard and DesignScript Libraries
import sys
import clr
clr.AddReference('ProtoGeometry')
from Autodesk.DesignScript.Geometry import *

# The inputs to this node will be stored as a list in the IN variables.
dataEnteringNode = IN

# Place your code below this line

# Assign your output to the OUT variable.

x = IN[0]
OUT = x
# ----------------------------------------
exportCSV = Data.ExportCSV(filePath=file_path, data=python_script)
code_block = CodeBlock { Parameter.ParameterByName; }
value = Parameter.Value()  # unwired: parameter
exportToExcel = Data.ExportToExcel(filePath=file_path, data=python_script)  # unwired: sheetName, startRow, startColumn
